# Dynamo graph CriarTabela.dyn (Dynamo 2.10.1.3976)

current = Document.Current()
activeView = Document.ActiveView(document=current)
comprimento = DoubleSlider(3.7, range=0.1..10 step 0.1)
largura = DoubleSlider(5.7, range=0.1..10 step 0.1)
colunas = DoubleSlider(6, range=1..30 step 1)
linhas = DoubleSlider(5, range=1..30 step 1)
criarCelulas = Python(IN[0]=activeView, IN[1]=comprimento, IN[2]=largura, IN[3]=colunas, IN[4]=linhas)  # CPython3
# ---------- criarCelulas.python (48 lines) ----------
# Carregar as bibliotecas DesignScript e padrão do Python
import sys
import clr
clr.AddReference('ProtoGeometry')
from Autodesk.DesignScript.Geometry import *

view = IN[0]

largura_total = IN[1]
comprimento_total = IN[2]
colunas = int(IN[3])
linhas = int(IN[4])

largura = largura_total/linhas
comprimento = comprimento_total/colunas

tabela = []

def criar_retangulo():
	retangulo = Rectangle.ByWidthLength(largura,comprimento)
	exploded = Geometry.Explode(retangulo)
	#curves = DetailCurve.ByCurve(view,exploded)
	return exploded
	
	
def mover(lista, coluna, linha):
	geometria = []
	for item in lista:
		item = Geometry.Translate(item,coluna*(largura),linha*(comprimento),0)
		geometria.append(item)
	return geometria


def principal():
    for linha in range(linhas):
    	l = []
    	
    	for coluna in range(colunas):
    		celula = criar_retangulo()
    		celula = mover(celula, coluna, linha)
    		l.append(celula)
    	
    	tabela.append(l[:])

    return tabela


OUT = principal()
# ----------------------------------------
byCurve = DetailCurve.ByCurve(view=activeView, curve=criarCelulas)
string = StringInput("C:\Users\FD PROJETOS2\Desktop\_\tiago_lima\dynamo_rvt\data.txt")
string_2 = StringInput("\t")
obterDadosDeArquivo = Python(IN[0]=string, IN[1]=string_2)  # CPython3
# ---------- obterDadosDeArquivo.python (41 lines) ----------
# Carregar as bibliotecas DesignScript e padrão do Python
import sys
import clr
clr.AddReference('ProtoGeometry')
from Autodesk.DesignScript.Geometry import *

nome_arquivo = IN[0]
separador = '\t'

def ler_arquivo():
    with open(nome_arquivo,'r',encoding='utf-8') as arquivo:
        return arquivo.readlines()
        
def preencher_dados(dicionario,chaves,conteudo):
    for linha in conteudo:
        dados_campos = linha.strip().split(separador)
    
        for n,dado in enumerate(dados_campos):
            dicionario[chaves[n]].append(dado)
        
    return dicionario
        
def obter_dados(conteudo):
    dados = {}
    chaves = conteudo[0].strip().split(separador)
    conteudo = conteudo[1:]
    
    for chave in chaves:
        dados[chave] = []
    
    dados = preencher_dados(dados,chaves,conteudo)
            
    return dados
       
def principal():
    conteudo = ler_arquivo()
    dados = obter_dados(conteudo)
    
    return dados
    
OUT = principal()
# ----------------------------------------
string_3 = StringInput("DESCRIÇÃO")
valueAtKey = DesignScript.Builtin.Dictionary.ValueAtKey(dictionary=obterDadosDeArquivo, key=string_3)
