# Dynamo graph Table.dyn (Dynamo 2.10.1.3976)

python_script = Python()  # CPython3; frozen; unwired: IN[0]
# ---------- python_script.python (60 lines) ----------
# Load the Python Standard and DesignScript Libraries
import sys
import clr

clr.AddReference("RevitServices")
import RevitServices
from RevitServices.Persistence import DocumentManager
from RevitServices.Transactions import TransactionManager

clr.AddReference("RevitAPI")

from Autodesk.Revit.DB import  (Transaction, ViewSchedule, 
                               ElementId, BuiltInCategory,
                               SchedulableField,ScheduleFieldType,
                               ScheduleDefinition)

def AddRegularFieldToSchedule(schedule, paramId)
    definition = schedule.Definition;

    schedulableField =
        definition.GetSchedulableFields().FirstOrDefault(lambda sf : sf.ParameterId == paramId);

    if schedulableField != null:
        definition.AddField(schedulableField);



doc = DocumentManager.Instance.CurrentDBDocument
uiapp = DocumentManager.Instance.CurrentUIApplication
uidoc = uiapp.ActiveUIDocument
app = uiapp.Application

tran = Transaction(doc)
tran.Start("Criar Tabela")

sampleSchedule = ViewSchedule.CreateSchedule(doc,ElementId(BuiltInCategory.OST_PipeCurves))

parameters = ViewSchedule.GetAvailableParameters(doc,ElementId(BuiltInCategory.OST_PipeCurves)) 

for param in parameters:
    try:
        sampleSchedule.Definition.AddField(SchedulableField(ScheduleFieldType.Instance, id))
    except:
        pass

    sampleDefinition = sampleSchedule.Definition
    
tran.Commit()

#uidoc.ActiveView = sampleSchedule

tran.Start( "Group headers" )
 
iFieldCount = sampleDefinition.GetFieldCount()

sampleSchedule.GroupHeaders(0,0,0,1, "Group Header")
 
tran.Commit();

OUT = iFieldCount
# ----------------------------------------
watch = Watch(python_script)
views = Views("DADOS - BOMBAS DE PRESSURIZAÇÃO")  # frozen
current = Document.Current()
getDataTable = Python(IN[0]=views, IN[1]=current)  # CPython3; graph output
# ---------- getDataTable.python (31 lines) ----------
# Carregar as bibliotecas DesignScript e padrão do Python
import sys
import clr
clr.AddReference('ProtoGeometry')
from Autodesk.DesignScript.Geometry import *

clr.AddReference('RevitAPI')
import Autodesk
from Autodesk.Revit.DB import Transaction

clr.AddReference("RevitServices")
import RevitServices
from RevitServices.Persistence import DocumentManager
doc = DocumentManager.Instance.CurrentDBDocument


element = UnwrapElement(IN[0])
tableData = element.GetTableData()
sectionData = tableData.GetSectionData(0)
cols = sectionData.get_NumberOfColumns()
rows = sectionData.get_NumberOfRows()

saida = [dir(element),dir(tableData),dir(sectionData)]
#OUT = saida

OUT = []


for row in range(rows):
    for col in range(cols):
        OUT.append(sectionData.GetCellText(row,col))
# ----------------------------------------
firstItem = List.FirstItem(list=getDataTable)
watch_2 = Watch(firstItem)
lastItem = List.LastItem(list=getDataTable)
watch_3 = Watch(lastItem)
watch_4 = Watch(getDataTable)
createTable = Python()  # CPython3; unwired: IN[0]
# ---------- createTable.python (39 lines) ----------
import clr
clr.AddReference('RevitAPI')
clr.AddReference('RevitServices')
from Autodesk.Revit.DB import FilteredElementCollector, ElementCategoryFilter, ScheduleFieldType, BuiltInCategory
from Autodesk.Revit.DB import ScheduleDefinition, ScheduleField, ViewSchedule
from RevitServices.Persistence import DocumentManager
from RevitServices.Transactions import TransactionManager

# Access the active Revit document
doc = DocumentManager.Instance.CurrentDBDocument

# Start a transaction
TransactionManager.Instance.EnsureInTransaction(doc)

try:
    # Create a filter for pipes category
    pipeCategory = ElementCategoryFilter(BuiltInCategory.OST_PipeCurves)
    
    # Create a ViewSchedule for the pipe schedule
    scheduleView = ViewSchedule.CreateSchedule(doc, pipeCategory.CategoryId)
    
    # Get the associated ScheduleDefinition of the created ViewSchedule
    scheduleDefinition = scheduleView.Definition
    
    # Get an existing parameter to use as a custom field
    parameterToUse = doc.GetElement("-1010106")  # Replace parameterId with the actual parameter's ElementId
    
    # Create a ScheduleField using the existing parameter
    parameterField = ScheduleField.Create(scheduleDefinition, parameterToUse.Id)

except Exception as e:
    # If an error occurs, rollback the transaction
    TransactionManager.Instance.TransactionTaskDone()
    raise e
    
# Commit the transaction
TransactionManager.Instance.TransactionTaskDone()
    
    
# ----------------------------------------

# group: GetParameterId
select_model_element = DSModelElementSelection()  # 1 picked in the model
parameters = Element.Parameters(element=select_model_element)
number = DoubleInput(6)
getItemAtIndex = List.GetItemAtIndex(list=parameters, index=number)
id = Parameter.Id(parameter=getItemAtIndex)
